vi "Function.gvi"   [LabVIEW Platform Developer Preview 0.1.0]
panel controls:
  "Trigger Send": bool
  "Trigger Reset": bool
panel indicators:
  "Send File": bool
  "Temp": f64[][]
  "Buffer": f64
  "Files Sent": f64
  "Available Memory": f64
  "Available Disk": f64
  "Reset": bool
uses:
  Component::Read Tag (Double).gvi
  Component::Build Array.gvi
  Component::Reset Aggregates.gvi
  Component::Update Tag (Double).gvi
diagram:
  w1 = "ec2-52-90-2-25.compute-1.amazonaws.com"  # Server
  w2 = "ni-crio-9068-190cb7b"  # Target
  while {
    Wait(time to wait=1000)
    w3 = ["available_disk", "available_memory", "files_sent", "buffer", "ai.0"]
    for (iteration -> i1) {
      w4 = each element of w3
      Concatenate Strings(w2, ".", w4) -> w5
      case (i1) {
        frame 0, Default {
          call "Read Tag (Double).gvi"(Server=w1, Tag=w5) -> (Value=w6)
          $"Available Disk" <- w6
        }
        frame 1 {
          call "Read Tag (Double).gvi"(Server=w1, Tag=w5) -> (Value=w7)
          $"Available Memory" <- w7
        }
        frame 2 {
          call "Read Tag (Double).gvi"(Server=w1, Tag=w5) -> (Value=w8)
          $"Files Sent" <- w8
        }
        frame 3 {
          call "Read Tag (Double).gvi"(Server=w1, Tag=w5) -> (Value=w9)
          $Buffer <- w9
        }
        frame 4 {
          call "Read Tag (Double).gvi"(Server=w1, Tag=w5) -> (Value=w10, Average=w11, Minimum=w12, Maximum=w13)
          call "Build Array.gvi"(Numeric=w10, Numeric_2=w12, Numeric_3=w11, Numeric_4=w13) -> (value=w14)
          $Temp <- w14
        }
      }
    }
    stop if FALSE
  }
  while {
    Wait(time to wait=50)
    case ($"Trigger Reset") {
      frame False, Default {
        $Reset <- FALSE
      }
      frame True {
        $Reset <- TRUE
        Concatenate Strings(w2, ".", "ai.0") -> w15
        call "Reset Aggregates.gvi"(Server=w1, Tag=w15)
        Wait(time to wait=500)
      }
    }
    case ($"Trigger Send") {
      frame False, Default {
        $"Send File" <- FALSE
      }
      frame True {
        $"Send File" <- TRUE
        Concatenate Strings(w2, ".", "send_file") -> w16
        call "Read Tag (Double).gvi"(Server=w1, Tag=w16) -> (Value=w17)
        Increment(x=w17) -> w18
        call "Update Tag (Double).gvi"(Server=w1, Tag=w16, Tag Value=w18)
        Wait(time to wait=500)
      }
    }
    stop if FALSE
  }
